# Grasshopper definition 0827.gh (Grasshopper 0.9.76)
# plug-ins: Human, HS_Toolbox

brep = Brep([<brep referenced from the Rhino model> x2])
toggle = BooleanToggle(False)
item = ListItem(List=brep, Index=0, Wrap=True)
make2d_viewport = Make2D_ViewPort(GeometryForMaking2D=brep, Start=toggle, HiddenLine=toggle, Tolerance=Slider(0.1, range=0..0.1))  # -> SolidCrv, HiddenCrv, Message, B, Cam, Corner
debrep = DeconstructBrep(Brep=item)  # -> Faces, Edges, Vertices
curvepoint = PointOnCurve(debrep.Edges, parameter=0.5)
points = PointList(Points=curvepoint, Size=Slider(100, range=0..100))
previewlw = CustomPreviewLineweights(
    Geometry=make2d_viewport.HiddenCrv,
    Shader=ColourSwatch(SwatchColor=RGB(145, 141, 141)),
    Thickness=Slider(2, range=0..10),
    Absolute=False)
previewlw_2 = CustomPreviewLineweights(
    Geometry=make2d_viewport.SolidCrv,
    Shader=ColourSwatch(SwatchColor=RGB(255, 255, 255)),
    Thickness=Slider(8, range=0..10),
    Absolute=False)
