# Grasshopper definition Google Elevation Quary.gh (Grasshopper 0.9.76)
# plug-ins: Heron

restgeocode = ESRIRESTServiceGeocode(Addresses="hunter mountain, ny")  # -> Candidates, simplify(Latitude), simplify(Longitude)
number_slider = Slider(1, range=0..1)
branch = TreeBranch(Tree=restgeocode.Latitude, Path=number_slider, MaintainPaths=True)
branch_2 = TreeBranch(Tree=restgeocode.Longitude, Path=number_slider, MaintainPaths=True)
panel = Panel(restgeocode.Candidates)
ddtoxy = DecimalDegreesToXY(Latitude=branch, Longitude=branch_2)
pdecon = Deconstruct(Point=ddtoxy)  # -> XComponent, YComponent, ZComponent
series = Series(Start=0, Step=Slider(10, range=0..10), Count=10)
pt = ConstructPoint(XCoordinate=series, YCoordinate=pdecon.YComponent, ZCoordinate=0)  # disabled
restrevgeo = ESRIRESTServiceReverseGeocode(XyPoint=pt)  # -> Address, Neighborhood, City, Region, Postal, Country, LAT, LON
data = Data(["42.20484", "42.20484", "42.20484", "42.20484", "42.20484", "42.20484", "42.20484", "42.20484", "42.20484", "42.20484"])
data_2 = Data(["0", "8.98315565805401E-05", "0.00017966311316108", "0.00026949466974162", "0.00035932622632216", "0.000449157782902701", "0.000538989339483241", "0.000628820896063781", "0.000718652452644321", "0.000808484009224861"])
