# Grasshopper definition make2d_debug.gh (Grasshopper 0.9.76)
# plug-ins: Human, HS_Toolbox

brep = Brep([<brep referenced from the Rhino model> x6])
debrep = DeconstructBrep(Brep=brep)  # -> Faces, Edges, Vertices
make2d_viewport = Make2D_ViewPort(GeometryForMaking2D=brep, Start=Toggle(True), HiddenLine=Toggle(True))  # -> SolidCrv, HiddenCrv, B, Cam
curvepoint = PointOnCurve(debrep.Edges, parameter=0.5)
points = PointList(Points=curvepoint, Size=Slider(4, range=0..10))
destructattribute_crv = DeconstructAttribute_Crv(CurveForRetrievingData=make2d_viewport.SolidCrv)  # -> DictionaryName, DictionaryData
destructattribute_crv_2 = DeconstructAttribute_Crv(CurveForRetrievingData=make2d_viewport.HiddenCrv)  # -> DictionaryName, DictionaryData
item = ListItem(List=destructattribute_crv.DictionaryData, Index=0, Wrap=True)  # -> flatten(Item)
item_2 = ListItem(List=destructattribute_crv_2.DictionaryData, Index=0, Wrap=True)  # -> flatten(Item)
number_slider = Slider(3, range=0..10)
number_slider_2 = Slider(3, range=0..10)
one_over_x = OneOverX(Value=item)
one_over_x_2 = OneOverX(Value=item_2)
number_slider_3 = Slider(5, range=0..10)
number_slider_4 = Slider(5, range=0..10)
bnd = Bounds(Numbers=one_over_x)
bnd_2 = Bounds(Numbers=one_over_x_2)
dom = ConstructDomain(DomainStart="0.01", DomainEnd=number_slider)
dom_2 = ConstructDomain(DomainStart="0.01", DomainEnd=number_slider_2)
remap = RemapNumbers(Value=one_over_x, Source=bnd, Target=dom)  # -> Mapped, Clipped
remap_2 = RemapNumbers(Value=one_over_x_2, Source=bnd_2, Target=dom_2)  # -> Mapped, Clipped
division = Division(A=number_slider, B=number_slider_3)
division_2 = Division(A=number_slider_2, B=number_slider_4)
series = Series(Start="0.01", Step=division, Count=number_slider_3)
ins = InsertItems(List=series, Item=number_slider, Indices=-1, Wrap=True)
series_2 = Series(Start="0.01", Step=division_2, Count=number_slider_4)
ins_2 = InsertItems(List=series_2, Item=number_slider_2, Indices=-1, Wrap=True)
shift = ShiftList(List=ins, Shift=1, Wrap=False)
shift_2 = ShiftList(List=ins_2, Shift=1, Wrap=False)
cull_i = CullIndex(List=ins, Indices=-1, Wrap=True)
cull_i_2 = CullIndex(List=ins_2, Indices=-1, Wrap=True)
dom_3 = ConstructDomain(DomainStart=cull_i, DomainEnd=shift)
dom_4 = ConstructDomain(DomainStart=cull_i_2, DomainEnd=shift_2)
inc = Includes(Value=remap.Mapped, Domain=graft(dom_3))  # -> simplify(Includes), Deviation
inc_2 = Includes(Value=remap_2.Mapped, Domain=graft(dom_4))  # -> simplify(Includes), Deviation
dispatch = Dispatch(List=make2d_viewport.SolidCrv, DispatchPattern=inc.Includes)  # -> ListA, ListB
dispatch_2 = Dispatch(List=make2d_viewport.HiddenCrv, DispatchPattern=inc_2.Includes)  # -> ListA, ListB
previewlw = CustomPreviewLineweights(
    Geometry=simplify(dispatch.ListA),
    Shader=ColourSwatch(SwatchColor=RGB(255, 255, 255)),
    Thickness=simplify(graft(series)),
    Absolute=False)
previewlw_2 = CustomPreviewLineweights(
    Geometry=simplify(dispatch_2.ListA),
    Shader=ColourSwatch(SwatchColor=RGB(161, 161, 161)),
    Thickness=simplify(graft(series_2)),
    Absolute=False)
