# Grasshopper definition batch Render.gh (Grasshopper 0.9.76)
# plug-ins: HS_Toolbox, setFlounderCamera

# ---- group: Animate this for batch render
number_slider = Slider(400, range=0..400)

# ----
number_slider_2 = Slider(10, range=0..10)

# ---- group: Camera Rail
crv = Curve(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)

# ----
flip = FlipCurve(Curve=crv)  # -> Curve, Flag
addition = Addition(A=Slider(400, range=0..1000), B=number_slider_2)
int = Integer(number_slider)
divide = DivideCurve(Curve=flip.Curve, Count=addition, Kinks=False)  # -> Points, Tangents, Parameters
batch_render = BatchAnimation_Rendering(
    Start=Toggle(True),
    FolderToSaveRenderings="C:\Users\HANSHEN\Downloads\0805",
    FileName="test",
    SliderForAnimationSequence=int)
item = ListItem(List=divide.Points, Index=number_slider, Wrap=True)
item_2 = ListItem(List=divide.Points, Index=number_slider_2, Wrap=True)
syncfloundercamera = SyncFlounderCamera(
    Activate=Toggle(True),
    ViewportName="new",
    Location=item,
    Target=item_2,
    Lens=Slider(15, range=0..100),
    Up=Vector(-0.004117375259, -0.0001556715353, 0.9999915115))
