# Grasshopper definition CloestCrvsInRange + ZoomIterator.gh (Grasshopper 0.9.76)
# plug-ins: Human, HS_Toolbox

# ---- group: Key Crvs
# Index from the searched curves
crv = Curve([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])

# ---- group: Crvs to be searched
crv_2 = Curve([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])

# ---- group: Set true to visualize the range
toggle = BooleanToggle(False)

# ---- group: Search Range
number_slider = Slider(1, range=0..30)

# ---- group: Child Crv Percentage Tolerance, for exampe: for tolerance domain between 90% - 110%, input 0.1 HERE
number_slider_2 = Slider(0.25, range=0..1)

# ----
cloestcrvsinrange = CloestCrvsInRange(CrvA=crv, CrvB=crv_2, Preview=toggle, Distance=number_slider, Tolerance=number_slider_2)  # -> simplify(Index), PipeBrep, Distance, ChildParent

# ---- group: Has value if found
# Key Curve Index
panel = Panel(cloestcrvsinrange.Index)

# ----
clean = CleanTree(RemoveNulls=True, RemoveInvalid=True, RemoveEmpty=True, Tree=cloestcrvsinrange.Index)
tstat = TreeStatistics(Tree=clean)  # -> Paths, Length, Count

# ---- group: Bigger the number the less zoomed
number_slider_3 = Slider(1, range=0..10)

# ---- group: Set true to begin looping
toggle_2 = BooleanToggle(True)

# ----
# Curves with formated structure
split = SplitTree(Data=simplify(graft(crv)), Masks=flatten(tstat.Paths))  # -> Positive, Negative
item = ListItem(List=crv_2, Index=cloestcrvsinrange.Index, Wrap=True)
zoom_iterator = ZoomIterator(
    InputGeometryForSpotChecking=flatten(split.Positive),
    ScaleFactorForZooming=number_slider_3,
    SetTrueToStart=toggle_2,
    SleepInterval=Slider(100, range=0..1000))
number_slider_4 = Slider(0, range=0..100)

# ---- group: Key Curves
branch = TreeBranch(Tree=split.Positive, Path=number_slider_4, MaintainPaths=True)

# ---- group: Searched Crves
branch_2 = TreeBranch(Tree=item, Path=number_slider_4, MaintainPaths=True)

# ----
previewlw = CustomPreviewLineweights(Geometry=split.Positive, Shader=ColourSwatch(SwatchColor=RGB(38, 255, 0)), Absolute=False)
previewlw_2 = CustomPreviewLineweights(Geometry=item, Shader=ColourSwatch(SwatchColor=RGB(255, 255, 255)), Absolute=False)
