# Grasshopper definition ZoomIterator.gh (Grasshopper 0.9.76)
# plug-ins: HS_Toolbox

series = Series(Start=0, Step=0.1, Count=10)
series_2 = Series(Start=0, Step=Slider(10, range=0..10), Count=10)
pt = ConstructPoint(XCoordinate=series_2, YCoordinate=0, ZCoordinate=0)
gradient = Gradient(
    LowerLimit=0,
    UpperLimit=1,
    Parameter=series,
    stops=[0: RGB(234, 38, 0), 0.25: RGB(234, 126, 0), 0.5: RGB(254, 244, 84), 0.75: RGB(173, 203, 249), 1: RGB(75, 107, 169)])

# ---- group: Bigger the number the less zoomed
number_slider = Slider(1, range=0..10)

# ----
sph = Sphere(Base=pt, Radius=Slider(2, range=0..10))

# ---- group: Set true to begin looping
toggle = BooleanToggle(True)

# ----
preview = CustomPreview(Geometry=sph, Shader=gradient)
zoom_iterator = ZoomIterator(
    InputGeometryForSpotChecking=sph,
    ScaleFactorForZooming=number_slider,
    SetTrueToStart=toggle,
    SleepInterval=Slider(100, range=0..1000))
