# Grasshopper definition directLight.gh (Grasshopper 0.9.76)
# plug-ins: HS_Toolbox

pt = ConstructPoint(XCoordinate=0, YCoordinate=0, ZCoordinate=Slider(62, range=0..100))
pt_2 = ConstructPoint(XCoordinate=Slider(61, range=0..100), YCoordinate=0, ZCoordinate=Slider(10, range=0..10))
adddirectionallight = AddDirectionalLight_ViewPort(
    Name="direct 1",
    Location=pt,
    DiffuseColor=ColourSwatch(SwatchColor=RGB(81, 252, 187)),
    DirectionalLight=Toggle(True),
    TargetPoint=pt_2,
    InitializeTheLight=Toggle(True))
