# Grasshopper definition AddAttribute_Crv+CloestCrvsInRange + ZoomIterator.gh (Grasshopper 0.9.76)
# plug-ins: Human, HS_Toolbox

# ---- group: Rotation Angles
data = Data([90, 0, 0, 0, 0, 0, 0, 0, 0, 0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])

# ---- group: BeamCrvs
crv = Curve([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])

# ---- group: Sections
# Model A
data_2 = Data(["W8X10", "W8X10", "W18X35", "W36X182", "W27X84", "W8X10", "W18X40", "W24X68", "W12X16", "W16X26", "W12X14", "W10X12", "W12X19", "W10X12", "W10X12", "W8X10", "W8X10", "W8X10", "W8X10", "W8X10", "W8X10", "W8X10", "W8X10", "W8X10", "W8X10", "W8X10", "W8X10", "W8X10", "W8X10", "W8X10", "W8X10", "W8X10", "W8X10", "W8X10"])

# ---- group: Rotation Angles
data_3 = Data([0, 0, 0, 0, 0, 0, 0, 0, 0, 0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])

# ---- group: BeamCrvs
crv_2 = Curve([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])

# ---- group: Sections
# Model B
data_4 = Data(["HSS8X4X1/8", "W12X19", "W8X10", "W27X84", "W40X183", "W24X68", "W8X10", "W24X62", "W8X10", "W8X10", "W27X84", "W12X19", "W12X16", "W18X40", "W8X10", "W12X19", "W8X10", "W24X68", "W36X135", "W27X84", "W27X84", "W12X19", "W12X19", "W12X19", "W16X26", "W8X10", "W8X10", "W8X10", "W18X35", "W12X16", "W40X431", "W33X118", "W8X10", "W8X10", "W36X182", "W8X10", "W8X10", "W12X19", "W12X19", "W27X84"])

# ----
panel = Panel("""Sections
Rotation Angles""")
panel_2 = Panel("""Sections
Rotation Angles""")
merge = Merge(Data1=graft(data_2), Data2=graft(data_3))  # -> simplify(Result)
merge_2 = Merge(Data1=graft(data_4), Data2=graft(data))  # -> simplify(Result)
addattribute_crv = AddAttribute_Crv(CurveForAddingAttribute=simplify(graft(crv)), NameOfTheDictionary=panel, NameOfTheAttribute=merge)  # -> flatten(AssignedCurve)
addattribute_crv_2 = AddAttribute_Crv(CurveForAddingAttribute=simplify(graft(crv_2)), NameOfTheDictionary=panel_2, NameOfTheAttribute=merge_2)  # -> flatten(AssignedCurve)

# ---- group: Crvs to be searched
crv_3 = Curve(addattribute_crv_2)

# ---- group: Set true to visualize the range
toggle = BooleanToggle(True)

# ---- group: Key Crvs
# Index from the searched curves
crv_4 = Curve(addattribute_crv)

# ---- group: Search Range
number_slider = Slider(1, range=0..30)

# ---- group: Child Crv Percentage Tolerance, for exampe: for tolerance domain between 90% - 110%, input 0.1 HERE
number_slider_2 = Slider(0.25, range=0..1)

# ----
cloestcrvsinrange = CloestCrvsInRange(CrvA=crv_4, CrvB=crv_3, Preview=toggle, Distance=number_slider, Tolerance=number_slider_2)  # -> simplify(Index), PipeBrep, Distance, ChildParent

# ---- group: Has value if found
panel_3 = Panel(cloestcrvsinrange.Index)

# ----
clean = CleanTree(RemoveNulls=True, RemoveInvalid=True, RemoveEmpty=True, Tree=cloestcrvsinrange.Index)
tstat = TreeStatistics(Tree=clean)  # -> Paths, Length, Count
split = SplitTree(Data=simplify(graft(crv_4)), Masks=flatten(tstat.Paths))  # -> Positive, Negative
item = ListItem(List=crv_3, Index=cloestcrvsinrange.Index, Wrap=True)

# ---- group: Distance
# Key Curve Index
panel_4 = Panel(cloestcrvsinrange.Distance)

# ----
curvepoint = PointOnCurve(split.Positive, parameter=0.465)
curvepoint_2 = PointOnCurve(item, parameter=0.515)
# Curves with formated structure
destructattribute_crv = DeconstructAttribute_Crv(CurveForRetrievingData=split.Positive)  # -> DictionaryName, DictionaryData
destructattribute_crv_2 = DeconstructAttribute_Crv(CurveForRetrievingData=item)  # -> DictionaryName, DictionaryData

# ---- group: Parent/Child
panel_5 = Panel(cloestcrvsinrange.ChildParent)

# ---- group: Set true to begin looping
toggle_2 = BooleanToggle(True)

# ---- group: Bigger the number the less zoomed
number_slider_3 = Slider(1.5, range=0..10)

# ----
panel_6 = Panel(destructattribute_crv.DictionaryName)
item_2 = ListItem(List=destructattribute_crv.DictionaryData, Index=0, Wrap=True)
item_3 = ListItem(List=destructattribute_crv_2.DictionaryData, Index=0, Wrap=True)
swatch = ColourSwatch(SwatchColor=RGB(38, 255, 0))
swatch_2 = ColourSwatch(SwatchColor=RGB(255, 255, 255))
zoom_iterator = ZoomIterator(
    InputGeometryForSpotChecking=flatten(split.Positive),
    ScaleFactorForZooming=number_slider_3,
    SetTrueToStart=toggle_2,
    SleepInterval=Slider(1000, range=0..1000))
previewlw = CustomPreviewLineweights(Geometry=split.Positive, Shader=swatch, Absolute=False)
previewlw_2 = CustomPreviewLineweights(Geometry=item, Shader=swatch_2, Absolute=False)
tag = TextTag3D(Location=curvepoint, Text=item_2, Size=1, Colour=swatch, Justification=7)
tag_2 = TextTag3D(Location=curvepoint_2, Text=item_3, Size=1, Colour=swatch_2, Justification=7)
