# Grasshopper definition Get site  elevation.gh (Grasshopper 0.9.76)
# plug-ins: Human, HS_Toolbox, Heron, Weaverbird

# ---- group: Input Address
# Step 1: Use address lookup to find the location point
panel = Panel("Grand Canyon National Park")

# ---- group: Catalog of ESRI ArcGIS REST Basemaps
esri_arcgis_base_maps = ValueList({"World Imagery": "http://server.arcgisonline.com/ArcGIS/rest/services/World_Imagery/MapServer/export?", "World Topographic": "http://server.arcgisonline.com/ArcGIS/rest/services/World_Topo_Map/MapServer/export?", "World Physical Map": "http://server.arcgisonline.com/ArcGIS/rest/services/World_Physical_Map/MapServer/export?", "World Street Map": "http://server.arcgisonline.com/ArcGIS/rest/services/World_Street_Map/MapServer/export?", "World DeLorme Street Map": "http://server.arcgisonline.com/ArcGIS/rest/services/Specialty/DeLorme_World_Base_Map/MapServer/export?", "World Shaded Relief": "http://server.arcgisonline.com/ArcGIS/rest/services/World_Shaded_Relief/MapServer/export?", "World Terrain Base": "http://server.arcgisonline.com/ArcGIS/rest/services/World_Terrain_Base/MapServer/export?", "World Boundaries and Places": "http://server.arcgisonline.com/ArcGIS/rest/services/Reference/World_Boundaries_and_Places/MapServer/export?", "World Boundaries and Places Alt": "http://server.arcgisonline.com/ArcGIS/rest/services/Reference/World_Boundaries_and_Places_Alternate/MapServer/export?", "World Reference Overlay": "http://server.arcgisonline.com/ArcGIS/rest/services/Reference/World_Reference_Overlay/MapServer/export?", "World Transportation": "http://server.arcgisonline.com/ArcGIS/rest/services/Reference/World_Transportation/MapServer/export?", "World Light Gray Base": "http://server.arcgisonline.com/ArcGIS/rest/services/Canvas/World_Light_Gray_Base/MapServer/export?", "World Light Gray Reference": "http://server.arcgisonline.com/ArcGIS/rest/services/Canvas/World_Light_Gray_Reference/MapServer/export?", "National Geographic World": "http://services.arcgisonline.com/ArcGIS/rest/services/NatGeo_World_Map/MapServer/export?", "USA Topo Maps": "http://server.arcgisonline.com/ArcGIS/rest/services/USA_Topo_Maps/MapServer/export?"}, selected="World Street Map")

# ---- group: Set a boundry rectangle curve in rhino that contains the area that you want to qury
crv = Curve(<curve referenced from the Rhino model>)

# ----
# Step 3: Deconstruct the box and set resolution for qury.
explode = Explode(Curve=crv, Recursive=True)  # -> Segments, Vertices

# ---- group: USGS Raster Maps
usgs = ValueList({"Ortho 1 Foot Imagery": "http://raster.nationalmap.gov/arcgis/rest/services/Orthoimagery/USGS_EROS_Ortho_1Foot/ImageServer/exportImage?", "Ortho Imagery": "http://raster.nationalmap.gov/arcgis/rest/services/Orthoimagery/USGS_EROS_Ortho/ImageServer/exportImage?", "NAIP Imagery": "http://raster.nationalmap.gov/arcgis/rest/services/Orthoimagery/USGS_EROS_Ortho_NAIP/ImageServer/exportImage?", "Land Cover": "http://raster.nationalmap.gov/arcgis/rest/services/LandCover/USGS_EROS_LandCover_NLCD/MapServer/export?", "Land Cover - Conus 01": "http://raster.nationalmap.gov/arcgis/rest/services/LandCover/conus_01/MapServer/export?", "Land Cover - Conus 06": "http://raster.nationalmap.gov/arcgis/rest/services/LandCover/conus_06/MapServer/export?", "Land Cover - Development": "http://raster.nationalmap.gov/arcgis/rest/services/LandCover/Development_0106/MapServer/export?", "Land Cover - Wetland": "http://raster.nationalmap.gov/arcgis/rest/services/LandCover/Wetland_0106/MapServer/export?", "Topo - Scanned Maps": "http://raster.nationalmap.gov/arcgis/rest/services/Scanned_Maps/USGS_EROS_DRG_SCALE/ImageServer/exportImage?"}, selected="Ortho 1 Foot Imagery")

# ----
restgeocode = ESRIRESTServiceGeocode(Addresses=panel)  # -> Candidates, flatten(Latitude), flatten(Longitude)

y_resolution = Slider(40, range=0..100)
x_resolution = Slider(40, range=0..100)

# ---- group: Not all imagery available at each resolution
resolution = ValueList({"None": , "Low": 256, "Med": 512, "High": 1024, "Max": 2048}, selected="High")

# ----
folder_location_for_images = Panel("C:\Heron\")
update_imagery = BooleanToggle(True)
image_prefix = Panel("test")
restraster = GetRESTRaster(
    Boundary=crv,
    Resolution=resolution,
    FileLocation=folder_location_for_images,
    Prefix=image_prefix,
    RESTURL=esri_arcgis_base_maps,
    Run=update_imagery)  # -> Image, ImageFrame, RESTQuery

# ---- group: RH_Input
# Author: Hanshen Sun
# hanshensunw@gmail.com
# Plugin Used: Heron, Weaverbird,
# Meshedit, Human, HSToolbox
pt = Point(Point(0, 0, 0))

pt_2 = Point(Point(0, 0, 0))

# ----
item = ListItem(List=explode.Segments, Index=0, Wrap=True)  # -> Item, Item1, Item2, Item3

# ---- group: Input
pt_3 = Point(Point(0, 0, 0))

pt_4 = Point(Point(0, 0, 0))

# ----
ddtoxy = DecimalDegreesToXY(Latitude=restgeocode.Latitude, Longitude=restgeocode.Longitude)

# ---- group: Could have multiple branches because there could be multiple location in the world that has the same name
panel_2 = Panel(restgeocode.Candidates)

# ----
item_2 = ListItem(List=restgeocode.Longitude, Index=0, Wrap=True)
item_3 = ListItem(List=restgeocode.Latitude, Index=0, Wrap=True)

# ----
# Step 2: Manipulate the input boundry crv to identify the region for qury
# Set the Earth Anchor Point: Runs a macro to set the Earth Anchor Point in Rhino.  This is important to minimize distortion translating from the curved surface of the Earth to Euclidean coordinates.
toggle = BooleanToggle(True)
longitude = Number(item_2)
latitude = Number(item_3)
seteap = SetEarthAnchorPoint(SetEAP=toggle, Latitude=latitude, Longitude=longitude)

# ---- group: Operation
pt_5 = Point(Point(0, 0, 0))

pt_6 = Point(Point(0, 0, 0))

# ----
divide = DivideCurve(Curve=item.Item3, Count=y_resolution, Kinks=False)  # -> reverse(Points), Tangents, Parameters
divide_2 = DivideCurve(Curve=item.Item1, Count=y_resolution, Kinks=False)  # -> Points, Tangents, Parameters

# ---- group: Output
pt_7 = Point(Point(0, 0, 0))

pt_8 = Point(Point(0, 0, 0))

# ----
item_4 = ListItem(List=ddtoxy, Index=0, Wrap=True)
xytodd = XYToDecimalDegrees(XyPoint=divide.Points)  # -> Latitude, Longitude
xytodd_2 = XYToDecimalDegrees(XyPoint=divide_2.Points)  # -> Latitude, Longitude

# ---- group: Visualization
pt_9 = Point(Point(0, 0, 0))

pt_10 = Point(Point(0, 0, 0))

# ---- group: Set True to run
toggle_2 = BooleanToggle(True)

# ----
merge = Merge(Data1=graft(xytodd.Latitude), Data2=graft(xytodd_2.Latitude))
merge_2 = Merge(Data1=graft(xytodd.Longitude), Data2=graft(xytodd_2.Longitude))
boundary = BoundarySurfaces(Edges=restraster.ImageFrame)
surfacemap = SurfaceMapping(Mesh=graft(crv), Surface=boundary)

# ---- group: Retrieve elevation data in meter/ if didnt work properly just rerun this component
# This Component takes the Lat/Lon of the two endpoints with a specified Y resolution. Using Google elevation Api to retrieve elevation data in Meter.
getelevation = GetElevation_GIS(Latitude=merge, Longitude=merge_2, Resolution=x_resolution, Run=toggle_2)  # -> Lat, Lon, Elevation

# ----
previewmat = CustomPreviewMaterials(Geometry=surfacemap, DiffuseColor=RGB(255, 255, 255), DiffuseBitmap=restraster.Image)
ddtoxy_2 = DecimalDegreesToXY(Latitude=getelevation.Lat, Longitude=getelevation.Lon)
Z = UnitZ(Factor=getelevation.Elevation)
move = Move(Geometry=ddtoxy_2, Motion=Z)  # -> Geometry, Transform
pline = PolyLine(Vertices=move.Geometry, Closed=False)
clean = CleanTree(RemoveNulls=True, RemoveInvalid=True, RemoveEmpty=True, Tree=getelevation.Elevation)
clean_2 = CleanTree(RemoveNulls=True, RemoveInvalid=True, RemoveEmpty=False, Tree=flatten(pline))
bnd = Bounds(Numbers=flatten(getelevation.Elevation))
digit = Slider(1, range=0..10)
loft = Loft(
    Curves=flatten(clean_2),
    Options={Adjust=False, Closed=False, LoftEnds=0, LoftSimp=0, LoftType=0, Rebuild=10, Refit=0.01})
remap = RemapNumbers(Value=getelevation.Elevation, Source=bnd, Target=Domain(0, 1))  # -> Mapped, Clipped
mesh = MeshBrep(
    Brep=loft,
    Settings={GridMaxCount=0, GridMinCount=16, JaggedSeams=False, MaxEdgeLength=0, MinEdgeLength=0.0001, MinTolerance=0, Refine=True, RefineAngle=0, RelativeTolerance=0.65, SimplePlanes=True, Tolerance=0})
del = DelaunayMesh(Points=flatten(move.Geometry), Plane=PlaneXY(0, 0, 0))
gradient = Gradient(LowerLimit=0, UpperLimit=1, Parameter=remap.Mapped, stops=[0: RGB(26, 81, 163), 1: RGB(122, 242, 92)])
expression = Expression(x=clean, y=digit, Expression="Round(x,y)")
wblaplace = WeaverbirdsLaplacianSmoothing(MeshCurves=del, Level=1, SmoothNakedEdges=0, Thin=1)
Z_2 = UnitZ(Factor=1)
concat = Concatenate(FragmentA=expression, FragmentB="m")
contour = Contour(Shape=loft, Point=Point(0, 0, 0), Direction=Z_2, Distance=Slider(50, range=0..100))
preview = CustomPreview(
    Geometry=mesh,
    Shader={ambient=RGB(128, 128, 128), diffuse=RGB(255, 224, 192), emission=RGB(76, 32, 54), shine=0.5, specular=RGB(255, 255, 255), transparency=0.25})
dots = DotDisplay(Point=flatten(move.Geometry), Colour=flatten(gradient), Size=Slider(30, range=0..100))

# ---- group: Turn on preview for elevation tags
tag = TextTag3D(
    Location=move.Geometry,
    Text=concat,
    Size=Slider(52, range=0..100),
    Colour=ColourSwatch(SwatchColor=RGB(255, 255, 255)),
    Justification=7)

# ----
previewlw = CustomPreviewLineweights(Geometry=contour, Shader=ColourSwatch(SwatchColor=RGB(255, 255, 255)), Absolute=False)
