# Grasshopper definition Get site  elevation_debug.gh (Grasshopper 0.9.76)
# plug-ins: Human, HS_Toolbox, Heron, Weaverbird

# ---- group: Input Address
# Step 1: Use address lookup to find the location point
panel = Panel("Kingston,ny")

# ----
usgs = ValueList({"Ortho 1 Foot Imagery": "http://raster.nationalmap.gov/arcgis/rest/services/Orthoimagery/USGS_EROS_Ortho_1Foot/ImageServer/exportImage?", "Ortho Imagery": "http://raster.nationalmap.gov/arcgis/rest/services/Orthoimagery/USGS_EROS_Ortho/ImageServer/exportImage?", "NAIP Imagery": "http://raster.nationalmap.gov/arcgis/rest/services/Orthoimagery/USGS_EROS_Ortho_NAIP/ImageServer/exportImage?", "Land Cover": "http://raster.nationalmap.gov/arcgis/rest/services/LandCover/USGS_EROS_LandCover_NLCD/MapServer/export?", "Land Cover - Conus 01": "http://raster.nationalmap.gov/arcgis/rest/services/LandCover/conus_01/MapServer/export?", "Land Cover - Conus 06": "http://raster.nationalmap.gov/arcgis/rest/services/LandCover/conus_06/MapServer/export?", "Land Cover - Development": "http://raster.nationalmap.gov/arcgis/rest/services/LandCover/Development_0106/MapServer/export?", "Land Cover - Wetland": "http://raster.nationalmap.gov/arcgis/rest/services/LandCover/Wetland_0106/MapServer/export?", "Topo - Scanned Maps": "http://raster.nationalmap.gov/arcgis/rest/services/Scanned_Maps/USGS_EROS_DRG_SCALE/ImageServer/exportImage?"}, selected="Ortho 1 Foot Imagery")

# ---- group: Set a boundry rectangle curve in rhino that contains the area that you want to qury
# Step 2: Manipulate the input boundry crv to identify the region for qury
crv = Curve(<curve referenced from the Rhino model>)

# ----
# Step 3: Deconstruct the box and set resolution for qury.
explode = Explode(Curve=crv, Recursive=True)  # -> Segments, Vertices
restgeocode = ESRIRESTServiceGeocode(Addresses=panel)  # -> Candidates, flatten(Latitude), flatten(Longitude)

y_resolution = Slider(50, range=0..100)
x_resolution = Slider(100, range=0..100)

# ---- group: RH_Input
# Author: Hanshen Sun
# hanshensunw@gmail.com
# Plugin Used: Heron, Weaverbird,
# Meshedit, Human, HSToolbox
pt = Point(Point(0, 0, 0))

pt_2 = Point(Point(0, 0, 0))

# ----
item = ListItem(List=explode.Segments, Index=0, Wrap=True)  # -> Item, Item1, Item2, Item3

# ---- group: Input
pt_3 = Point(Point(0, 0, 0))

pt_4 = Point(Point(0, 0, 0))

# ----
restraster = GetRESTRaster(Boundary=crv, Resolution="3000", FileLocation="C:\Heron\", Prefix="test2", RESTURL=usgs, Run=Toggle(True))  # -> Image, ImageFrame, RESTQuery
earthcoordinatestoxy = EarthCoordinatesToXY_GIS(Lat=restgeocode.Latitude, Lon=restgeocode.Longitude)

# ---- group: Could have multiple branches because there could be multiple location in the world that has the same name
panel_2 = Panel(restgeocode.Candidates)

# ----
ddtoxy = DecimalDegreesToXY(Latitude=restgeocode.Latitude, Longitude=restgeocode.Longitude)

# ---- group: Operation
pt_5 = Point(Point(0, 0, 0))

pt_6 = Point(Point(0, 0, 0))

# ----
mesh = Mesh(crv)
divide = DivideCurve(Curve=item.Item3, Count=y_resolution, Kinks=False)  # -> reverse(Points), Tangents, Parameters
divide_2 = DivideCurve(Curve=item.Item1, Count=y_resolution, Kinks=False)  # -> Points, Tangents, Parameters

# ---- group: Output
pt_7 = Point(Point(0, 0, 0))

pt_8 = Point(Point(0, 0, 0))

# ----
boundary = BoundarySurfaces(Edges=restraster.ImageFrame)
xytodd = XYToDecimalDegrees(XyPoint=divide_2.Points)  # -> Latitude, Longitude
xytodd_2 = XYToDecimalDegrees(XyPoint=divide.Points)  # -> Latitude, Longitude
item_2 = ListItem(List=earthcoordinatestoxy, Index=0, Wrap=True)
pttoearthpt = PtToEarthPt(Pt=divide.Points)  # -> Lat, Lon
pttoearthpt_2 = PtToEarthPt(Pt=divide_2.Points)  # -> Lat, Lon

# ---- group: Visualization
pt_9 = Point(Point(0, 0, 0))

pt_10 = Point(Point(0, 0, 0))

# ----
surfacemap = SurfaceMapping(Mesh=mesh, Surface=boundary)

# ---- group: Set True to run
toggle = BooleanToggle(True)

# ----
merge = Merge(Data1=graft(xytodd_2.Latitude), Data2=graft(xytodd.Latitude))
merge_2 = Merge(Data1=graft(xytodd_2.Longitude), Data2=graft(xytodd.Longitude))

# ---- group: Visualizing Map
previewmat = CustomPreviewMaterials(Geometry=surfacemap, DiffuseColor=RGB(255, 255, 255), DiffuseBitmap=restraster.Image)

# ---- group: Retrieve elevation data in meter/ if didnt work properly just rerun this component
# This Component takes the Lat/Lon of the two endpoints with a specified Y resolution. Using Google elevation Api to retrieve elevation data in Meter.
getelevation = GetElevation_GIS(Latitude=merge, Longitude=merge_2, Resolution=x_resolution, Run=toggle)  # -> Lat, Lon, Elevation

# ----
sort = SortList(Keys=flatten(getelevation.Elevation))  # -> Keys, ValuesA
item_3 = ListItem(List=sort.Keys, Index=0, Wrap=True)
ddtoxy_2 = DecimalDegreesToXY(Latitude=getelevation.Lat, Longitude=getelevation.Lon)
earthcoordinatestoxy_2 = EarthCoordinatesToXY_GIS(Lat=getelevation.Lat, Lon=getelevation.Lon, Ele=getelevation.Elevation)  # disabled
Z = UnitZ(Factor=getelevation.Elevation)
pt_11 = ConstructPoint(XCoordinate=0, YCoordinate=0, ZCoordinate=item_3)
move = Move(Geometry=ddtoxy_2, Motion=Z)  # -> Geometry, Transform
bnd = Bounds(Numbers=flatten(getelevation.Elevation))
digit = Slider(1, range=0..10)  # disabled
remap = RemapNumbers(Value=getelevation.Elevation, Source=bnd, Target=Domain(0, 1))  # -> Mapped, Clipped
del = DelaunayMesh(Points=flatten(move.Geometry), Plane=PlaneXY(0, 0, 0))
gradient = Gradient(LowerLimit=0, UpperLimit=1, Parameter=remap.Mapped, stops=[0: RGB(26, 81, 163), 1: RGB(122, 242, 92)])
number_slider = Slider(6, range=0..100)  # disabled
expression = Expression(x=getelevation.Elevation, y=digit, Expression="Round(x,y)")  # disabled
wblaplace = WeaverbirdsLaplacianSmoothing(MeshCurves=del, Level=1, SmoothNakedEdges=0, Thin=1)
Z_2 = UnitZ(Factor=1)
swatch = ColourSwatch(SwatchColor=RGB(255, 255, 255))  # disabled
contour = Contour(Shape=wblaplace, Point=pt_11, Direction=Z_2, Distance=Slider(0.1, range=0..1))

# ---- group: Turn on preview for elevation tags
tag = TextTag3D(Location=earthcoordinatestoxy_2, Text=expression, Size=number_slider, Colour=swatch, Justification=7)  # disabled

# ----
dots = DotDisplay(Point=flatten(earthcoordinatestoxy_2), Colour=flatten(gradient), Size=Slider(10, range=0..10))
