# Grasshopper definition gis debug.gh (Grasshopper 0.9.76)
# plug-ins: HS_Toolbox, Heron, LunchBox

pt = ConstructPoint(XCoordinate=Slider(500, range=0..1000), YCoordinate=Slider(1000, range=0..1000), ZCoordinate=0)
pt_2 = ConstructPoint(XCoordinate=Slider(1000, range=0..1000), YCoordinate=Slider(1000, range=0..1000), ZCoordinate=0)
pt_3 = Point([Point(-5070993.111, 1304167.045, 0), Point(5379223.981, 1304167.045, 0)])
merge = Merge(Data1=pt, Data2=pt_2)
pt_4 = Point(pt_3)
xytodd = XYToDecimalDegrees(XyPoint=pt_4)  # -> Latitude, Longitude
number_slider = Slider(10, range=0..10)
item = ListItem(List=pt_4, Index=0, Wrap=True)  # -> Item, Item1
split = TextSplit(Text="39.378196, -105.800077", Separators=",")
split_2 = TextSplit(Text="39.482345, -106.362885", Separators=",")
split_3 = TextSplit(Text="39.191233, -105.963691", Separators=",")
split_4 = TextSplit(Text="39.208796, -106.306548", Separators=",")
item_2 = ListItem(List=split, Index=0, Wrap=True)  # -> Item, Item1
item_3 = ListItem(List=split_2, Index=0, Wrap=True)  # -> Item, Item1
item_4 = ListItem(List=split_3, Index=0, Wrap=True)  # -> Item, Item1
item_5 = ListItem(List=split_4, Index=0, Wrap=True)  # -> Item, Item1
merge_2 = Merge(Data1=item_3.Item, Data2=item_2.Item)
merge_3 = Merge(Data1=item_3.Item1, Data2=item_2.Item1)
ddtoxy = DecimalDegreesToXY(Latitude=item_2.Item, Longitude=item_2.Item1)
ddtoxy_2 = DecimalDegreesToXY(Latitude=item_3.Item, Longitude=item_3.Item1)
ddtoxy_3 = DecimalDegreesToXY(Latitude=item_4.Item, Longitude=item_4.Item1)
ddtoxy_4 = DecimalDegreesToXY(Latitude=item_5.Item, Longitude=item_5.Item1)
getelevation = GetElevation_GIS(Latitude=merge_2, Longitude=merge_3)  # -> Lat, Lon, Elevation
ln = Line(StartPoint=ddtoxy, EndPoint=ddtoxy_3)
ln_2 = Line(StartPoint=ddtoxy_2, EndPoint=ddtoxy_4)
panel = Panel([getelevation.Lat, getelevation.Lon])
ddtoxy_5 = DecimalDegreesToXY(Latitude=getelevation.Lat, Longitude=getelevation.Lon)
item_6 = ListItem(List=ddtoxy_5, Index=0, Wrap=True)
ln_3 = Line(StartPoint=item_6, EndPoint=ddtoxy_2)
divide = DivideCurve(Curve=ln_2, Count=10, Kinks=False)  # -> Points, Tangents, Parameters
divide_2 = DivideCurve(Curve=ln, Count=10, Kinks=False)  # -> Points, Tangents, Parameters
dist = Distance(PointA=item_6, PointB=ddtoxy_2)
merge_4 = Merge(Data1=graft(divide.Points), Data2=graft(divide_2.Points))
panel_2 = Panel(ddtoxy_2)
panel_3 = Panel(ddtoxy_5)
xytodd_2 = XYToDecimalDegrees(XyPoint=merge_4)  # -> Latitude, Longitude
ln_4 = Line(StartPoint=divide.Points, EndPoint=divide_2.Points)
ln_5 = Line(StartPoint=ddtoxy_2, EndPoint=ddtoxy)
number_slider_2 = Slider(100, range=0..100)
getelevation_2 = GetElevation_GIS(Latitude=xytodd_2.Latitude, Longitude=xytodd_2.Longitude, Resolution=number_slider_2)  # -> Elevation, Lon, Ele; disabled
divide_3 = DivideCurve(Curve=ln_4, Count=expr("x-1", number_slider_2), Kinks=False)  # -> Points, Tangents, Parameters
number_slider_3 = Slider(2500, range=0..100000)
number_slider_4 = Slider(100, range=0..100)
pdecon = Deconstruct(Point=divide_3.Points)  # -> XComponent, YComponent, ZComponent
pt_5 = ConstructPoint(XCoordinate=pdecon.XComponent, YCoordinate=pdecon.YComponent, ZCoordinate=getelevation_2.Elevation)
number_slider_5 = Slider(50, range=0..100)
rectangle = Rectangle(Plane=ddtoxy_2, XSize=number_slider_3, YSize=number_slider_3, Radius=0)  # -> Rectangle, Length
merge_5 = Merge(Data1=pt_5)
pdecon_2 = Deconstruct(Point=merge_5)  # -> XComponent, YComponent, ZComponent
sort = SortList(Keys=pdecon_2.ZComponent, ValuesA=merge_5)  # -> Keys, ValuesA
grid = GridStructure(Surface=rectangle.Rectangle, UDivisions=number_slider_5, VDivisions=number_slider_5)  # -> StructureLines, StructureNodes
xytodd_3 = XYToDecimalDegrees(XyPoint=grid.StructureNodes)  # -> Latitude, Longitude
item_7 = ListItem(List=sort.ValuesA, Index=0, Wrap=True)
pline = PolyLine(Vertices=pt_5, Closed=False)
loft = Loft(Curves=pline, Options={Adjust=False, Closed=False, LoftEnds=0, LoftSimp=0, LoftType=0, Rebuild=10, Refit=0.01})  # disabled
Z = UnitZ(Factor=1)
concat = Concatenate(FragmentA=xytodd_3.Latitude, FragmentB=",", FragmentC=xytodd_3.Longitude)
contour = Contour(Shape=loft, Point=item_7, Direction=Z, Distance=Slider(10, range=0..10))  # disabled
