# Grasshopper definition herons.gh (Grasshopper 0.9.76)
# plug-ins: Human, HS_Toolbox, Heron

crv = Curve(<curve referenced from the Rhino model>)
usgs = ValueList({"Ortho 1 Foot Imagery": "http://raster.nationalmap.gov/arcgis/rest/services/Orthoimagery/USGS_EROS_Ortho_1Foot/ImageServer/exportImage?", "Ortho Imagery": "http://raster.nationalmap.gov/arcgis/rest/services/Orthoimagery/USGS_EROS_Ortho/ImageServer/exportImage?", "NAIP Imagery": "http://raster.nationalmap.gov/arcgis/rest/services/Orthoimagery/USGS_EROS_Ortho_NAIP/ImageServer/exportImage?", "Land Cover": "http://raster.nationalmap.gov/arcgis/rest/services/LandCover/USGS_EROS_LandCover_NLCD/MapServer/export?", "Land Cover - Conus 01": "http://raster.nationalmap.gov/arcgis/rest/services/LandCover/conus_01/MapServer/export?", "Land Cover - Conus 06": "http://raster.nationalmap.gov/arcgis/rest/services/LandCover/conus_06/MapServer/export?", "Land Cover - Development": "http://raster.nationalmap.gov/arcgis/rest/services/LandCover/Development_0106/MapServer/export?", "Land Cover - Wetland": "http://raster.nationalmap.gov/arcgis/rest/services/LandCover/Wetland_0106/MapServer/export?", "Topo - Scanned Maps": "http://raster.nationalmap.gov/arcgis/rest/services/Scanned_Maps/USGS_EROS_DRG_SCALE/ImageServer/exportImage?"}, selected="Land Cover")
restgeocode = ESRIRESTServiceGeocode(Addresses="Brooklyn Bridge")  # -> Candidates, flatten(Latitude), flatten(Longitude)
restraster = GetRESTRaster(Boundary=crv, Resolution="2048", FileLocation="C:\Heron\", Prefix="test2", RESTURL=usgs, Run=Toggle(True))  # -> Image, ImageFrame, RESTQuery
panel = Panel(restgeocode.Candidates)
ddtoxy = DecimalDegreesToXY(Latitude=restgeocode.Latitude, Longitude=restgeocode.Longitude)
earthcoordinatestoxy = EarthCoordinatesToXY(Lat=restgeocode.Latitude, Lon=restgeocode.Longitude)
mesh = Mesh(crv)
boundary = BoundarySurfaces(Edges=restraster.ImageFrame)
surfacemap = SurfaceMapping(Mesh=mesh, Surface=boundary)
previewmat = CustomPreviewMaterials(Geometry=surfacemap, DiffuseColor=RGB(255, 255, 255), DiffuseBitmap=restraster.Image)
getelevation = GetElevation_GIS()  # -> Lat, Lon, Elevation
pttoearthpt = PtToEarthPt()  # -> Lat, Lon
